# Dynamo custom node CurtainWallRowsAndColumns.dyf (Dynamo 1.2.1.3083)
# category: SCDynamoNodes.CurtainWalls
# Gets the number of rows and columns from a curtain wall

curtainWall = Input()

# group: CurtainWallRowsAndColumns
python_script = Python(IN[0]=curtainWall)
# ---------- python_script.python (16 lines) ----------
import clr
clr.AddReference('ProtoGeometry')
from Autodesk.DesignScript.Geometry import *

#The inputs to this node will be stored as a list in the IN variables.
dataEnteringNode = IN

vals = []
cWall = UnwrapElement(IN[0])
cWallRows = cWall.CurtainGrid.NumVLines + 1
cWallColumns = cWall.CurtainGrid.NumULines + 1

vals.insert(0,cWallRows)        
vals.insert(1,cWallColumns)    
#Assign your output to the OUT variable.
OUT = vals
# ----------------------------------------
firstItem = List.FirstItem(python_script)
lastItem = List.LastItem(python_script)

rows = Output(firstItem)  # "rows: int"
columns = Output(lastItem)  # "columns: int"
