# Dynamo custom node AngleOfCurve.dyf (Dynamo 1.2.1.3083)
# category: SCDynamoNodes.Geometry
# Get the angle between a curves startand end point

curve = Input(curve : Curve)
endPoint = Curve.EndPoint(curve)
Y = Point.Y(endPoint)
startPoint = Curve.StartPoint(curve)
Y_2 = Point.Y(startPoint)
y = CodeBlock(y2=Y, y1=Y_2) { y2 - y1; }
X = Point.X(endPoint)
X_2 = Point.X(startPoint)
x = CodeBlock(x2=X, x1=X_2) { x2 - x1; }
code_block = CodeBlock(y=y, x=x) { Math.Atan(y/x); }
Output = Output(code_block)  # ""
