# Dynamo graph CurtainWallReaderTest.dyn (Dynamo 1.2.1.3083)

select_model_element = DSModelElementSelection()  # 1 picked in the model
byElement = CurtainPanel.ByElement(select_model_element)
code_block = CodeBlock { "t"; }
file_path = Filename("C:\Andrew\code\cs\SCDynamoNodes\src\Tests\swirl.png")
fromPath = FileObject(file_path)  # "File.FromPath"
readFromFile = Image.ReadFromFile(fromPath)
watch_image = WatchImageCore(readFromFile)
curtainWallRowsAndColumns = Custom[CurtainWallRowsAndColumns](curtainWall=select_model_element)  # Gets the number of rows and columns from a curtain wall
pixels = Image.Pixels(image=watch_image, xSamples=curtainWallRowsAndColumns.rows, ySamples=curtainWallRowsAndColumns.columns)
flatten = Flatten(pixels)
brightness = Color.Brightness(flatten)
code_block_2 = CodeBlock(X=brightness) { X * 1000 + 1; }
setParameterByName = Element.SetParameterByName(element=byElement, parameterName=code_block, value=code_block_2)
watch = Watch(curtainWallRowsAndColumns.columns)
code_block_3 = CodeBlock { 100; }
