# Dynamo graph ParkingLayoutTest.dyn (Dynamo 1.2.1.3083)

family_types = FamilyTypes()
origin_points = CodeBlock()
# ---------- origin_points.designscript (4 lines) ----------
//ground level
Point.ByCoordinates(0,0,0);
//level b1
Point.ByCoordinates(0,0,-3100);
# ----------------------------------------
number_of_bays_in_x_direction = IntegerSlider(9, range=0..100 step 1)
number_of_bays_in_y_direction = IntegerSlider(6, range=0..100 step 1)
show_end_aisle = BoolSelector(true)
byLocation = ParkingLayout.ByLocation(origin_points.out0, arg5=number_of_bays_in_x_direction, arg6=number_of_bays_in_y_direction, arg7=show_end_aisle)
code_block = CodeBlock { -0; }
setLayoutRotation = ParkingLayout.SetLayoutRotation(byLocation, code_block)
hostPointsWithRotation = ParkingLayout.HostPointsWithRotation(setLayoutRotation)
byPoint = FamilyInstance.ByPoint(familyType=family_types, point=hostPointsWithRotation.out0)
setRotation = FamilyInstance.SetRotation(familyInstance=byPoint, degree=hostPointsWithRotation.out1)
watch = Watch(hostPointsWithRotation.out2)
byLocation_2 = ParkingLayout.ByLocation(origin_points.out1, arg5=number_of_bays_in_x_direction, arg6=number_of_bays_in_y_direction, arg7=show_end_aisle)
code_block_2 = CodeBlock { -0; }
setLayoutRotation_2 = ParkingLayout.SetLayoutRotation(byLocation_2, code_block_2)
hostPointsWithRotation_2 = ParkingLayout.HostPointsWithRotation(setLayoutRotation_2)
watch_2 = Watch(hostPointsWithRotation_2.out2)
byPoint_2 = FamilyInstance.ByPoint(familyType=family_types, point=hostPointsWithRotation_2.out0)
setRotation_2 = FamilyInstance.SetRotation(familyInstance=byPoint_2, degree=hostPointsWithRotation_2.out1)
