# Dynamo graph SightLinesTest.dyn (Dynamo 1.2.1.3083)

min_c = IntegerSlider(120, range=60..120 step 5)
rows = IntegerSlider(24, range=1..30 step 1)
code_block = CodeBlock { 5000; }

# group: Bottom Tier
min_c_2 = IntegerSlider(120, range=60..120 step 5)
rows_2 = IntegerSlider(24, range=1..30 step 1)
byValues = SightLines.SightLines.ByValues(arg3=min_c_2, arg5=rows_2, arg6=code_block)
profileGeometry = SightLines.SightLines.ProfileGeometry(byValues)

goingBackPoints = SightLines.SightLines.GoingBackPoints(byValues)
lastItem = List.LastItem(goingBackPoints)
pointValues = Points.PointValues(lastItem)
code_block_2 = CodeBlock(x=pointValues.out0) { x + 3000; }
code_block_3 = CodeBlock(z=pointValues.out2) { z + 1200; }
byValues_2 = SightLines.SightLines.ByValues(arg3=min_c, arg5=rows, arg6=code_block_2, arg7=code_block_3)
profileGeometry_2 = SightLines.SightLines.ProfileGeometry(byValues_2)

# group: Sydney Cricket Ground - AFL Mode
code_block_4 = CodeBlock { Point.ByCoordinates(0,0,0); }
code_block_5 = CodeBlock { 136000/2; 155500/2; }
byOriginRadii = Ellipse.ByOriginRadii(code_block_4, code_block_5.out0, code_block_5.out1)
byPatch = Surface.ByPatch(byOriginRadii)
perimeterCurves = Surface.PerimeterCurves(byPatch)
firstItem = List.FirstItem(perimeterCurves)

# group: Tiers
code_block_6 = CodeBlock { 0.5; }
splitByParameter = Curve.SplitByParameter(firstItem, code_block_6)
code_block_7 = CodeBlock(f=splitByParameter) { f[0]; }
coordinateSystemAtParameter = Curve.CoordinateSystemAtParameter(code_block_7)
origin = CoordinateSystem.Origin(coordinateSystemAtParameter)
YAxis = CoordinateSystem.YAxis(coordinateSystemAtParameter)
code_block_8 = CodeBlock { 180; }
rotate = CoordinateSystem.Rotate(coordinateSystem=coordinateSystemAtParameter, origin=origin, axis=YAxis, degrees=code_block_8)
transform = Geometry.Transform(profileGeometry_2, rotate)
bySweep = Surface.BySweep(transform, code_block_7)
transform_2 = Geometry.Transform(profileGeometry, rotate)
bySweep_2 = Surface.BySweep(transform_2, code_block_7)

code_block_9 = CodeBlock(f=splitByParameter) { f[1]; }
coordinateSystemAtParameter_2 = Curve.CoordinateSystemAtParameter(code_block_9)
origin_2 = CoordinateSystem.Origin(coordinateSystemAtParameter_2)
YAxis_2 = CoordinateSystem.YAxis(coordinateSystemAtParameter_2)
code_block_10 = CodeBlock { 180; }
rotate_2 = CoordinateSystem.Rotate(coordinateSystem=coordinateSystemAtParameter_2, origin=origin_2, axis=YAxis_2, degrees=code_block_10)
transform_3 = Geometry.Transform(profileGeometry_2, rotate_2)
bySweep_3 = Surface.BySweep(transform_3, code_block_9)
transform_4 = Geometry.Transform(profileGeometry, rotate_2)
bySweep_4 = Surface.BySweep(transform_4, code_block_9)
goingBackPoints_2 = SightLines.SightLines.GoingBackPoints(byValues_2)
lastItem_2 = List.LastItem(goingBackPoints_2)
Z = Point.Z(lastItem_2)
code_block_11 = CodeBlock(z=Z) { z + 2400; z + 6400; }
code_block_12 = CodeBlock(x=code_block_11.out0) { x * -1; }
X = Point.X(lastItem_2)
code_block_13 = CodeBlock(y=X) { y * -1; }
byCoordinates = Point.ByCoordinates(x=code_block_12, y=code_block_13)
roof_segments = CodeBlock { 12; }
divideCurve = Geometry.Curves.DivideCurve(code_block_7, roof_segments)
byPlane = CoordinateSystem.ByPlane(divideCurve.out1)
transform_5 = Geometry.Transform(byCoordinates, byPlane)
pointValues_2 = Points.PointValues(divideCurve.out0)
byCoordinates_2 = Point.ByCoordinates(x=pointValues_2.out0, y=pointValues_2.out1, z=code_block_11.out1)
byStartPointEndPoint = Line.ByStartPointEndPoint(startPoint=transform_5, endPoint=byCoordinates_2)
code_block_14 = CodeBlock { 0.5; }
pointAtParameter = Curve.PointAtParameter(curve=byStartPointEndPoint, param=code_block_14)
X_2 = Point.X(pointAtParameter)
Y = Point.Y(pointAtParameter)
Z_2 = Point.Z(pointAtParameter)
code_block_15 = CodeBlock(x=roof_segments) { 0..x; }
roof_ridge_max_height = CodeBlock { 6000; }
code_block_16 = CodeBlock(x=code_block_15, h=roof_ridge_max_height) { (x % 2) * h + 2000; }
code_block_17 = CodeBlock(z=Z_2, x=code_block_16) { z + x; }
byCoordinates_3 = Point.ByCoordinates(x=X_2, y=Y, z=code_block_17)
byThreePoints = Arc.ByThreePoints(firstPoint=transform_5, secondPoint=byCoordinates_3, thirdPoint=byCoordinates_2)
byLoft = Surface.ByLoft(byThreePoints)
